# Grasshopper definition xmlTest_diff(origin-main_to_main).ghx (Grasshopper 1.0.7)

# ---- group: removed_cmps
panel = Panel("sample(2021-11-24)-final-fix(xxx).ghx")

# ---- group: modified_cmps
panel_2 = Panel("2")

# ----
multiplication = Multiplication(A="8", B=panel_2)

# ---- group: added_cmps
panel_3 = Panel("grasshopper(.ghx) meets Git!")

# ----
sph = Sphere(Base=PlaneXY(0, 0, 0), Radius=multiplication)
